test file "Automated_test_file"

suite "New Test Suite 1"

  case "New Test Case 1" [baseline]
    test data file: Parameter_file.xlsx
    model jenkins_simulink_model
    parameter set "Parameter_file.xlsx" (off): const = 3.0  % mask workspace, jenkins_simulink_model/Compare To Constant3
    parameter set "Parameter_file.xlsx (1)" from Parameter_file.xlsx (off): const = 3.0  % mask workspace, jenkins_simulink_model/Compare To Constant3
    parameter set "Parameter_file.xlsx (2)" from Parameter_file.xlsx (off): const = 3.0  % mask workspace, jenkins_simulink_model/Compare To Constant3
    input "Scenario1" from Parameter_file.xlsx, mapped to excel_input -> Input
    input "Scenario2" from Parameter_file.xlsx, mapped to excel_input -> Input
    input "Scenario3" from Parameter_file.xlsx, mapped to excel_input -> Input
    iterations:
      Scenario1: ExternalInput "Scenario1", ParameterSet "Parameter_file.xlsx"
      Scenario2: ExternalInput "Scenario2", ParameterSet "Parameter_file.xlsx (1)"
      Scenario3: ExternalInput "Scenario3", ParameterSet "Parameter_file.xlsx (2)"